# Grasshopper definition S2-intro-to-graphs.gh (Grasshopper 1.0.8)
# plug-ins: MeshEdit Components, Bifocals

list = ValueList({"graphs-01-intro": 0, "graphs-02-graph-from-mesh": 1, "graphs-03-with-data": 2, "graphs-04-dual-graph": 3, "graphs-05-shorest-paths": 4}, selected="graphs-05-shorest-paths")
graphs_02_graph_from_mesh = FilePath("C:\Users\david\Desktop\Session02\session02\graphs\graphs-02-graph-from-mesh.py")
graphs_05_shorest_paths = FilePath("C:\Users\marti\OneDrive\Documents\MPDA\14_AT_APY\03_Assignment_3_MeshStripes\00_GH\MPDA25-Assignment3\graphs-05-shorest-paths.py")
graphs_04_dual_graph = FilePath("C:\Users\david\Desktop\Session02\session02\graphs\graphs-04-dual-graph.py")
graphs_03_with_data = FilePath("C:\Users\david\Desktop\Session02\session02\graphs\graphs-03-with-data.py")
graphs_01_intro = FilePath("C:\Users\david\Desktop\Session02\session02\graphs\graphs-01-intro.py")
filter = StreamFilter(
    Gate=list,
    Stream0=graphs_01_intro,
    Stream1=graphs_02_graph_from_mesh,
    Stream2=graphs_03_with_data,
    Stream3=graphs_04_dual_graph,
    Stream4=graphs_05_shorest_paths)
quadmesh = Mesh(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)
trimesh = Mesh(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)
panel = Panel(filter)
geo = Geometry()
file = ReadFile(File=filter, PerLineParse=False)
mesh = Mesh(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)
py3 = Python3Script(script=file, m=mesh, s=Slider(2, range=0..10), t=Slider(44, range=0..100))  # -> out, SP, a, b, c; inputs m: Mesh; unedited script template
explode = MeshExplode(Mesh=mesh, Interpolate=False)
item = ListItem(List=explode, Index=py3.c, Wrap=True)
